# Grasshopper definition retraction and approach_example.gh (Grasshopper 1.0.7)
# plug-ins: Pufferfish

bounding_rectangle = BoundingRectangle(Geometry=<missing>, Plane=PlaneXY(0, 0, 0), Axis=0, Slide=0, Union=True)  # -> Bounding, DimensionX, DimensionY
retract_distance = Slider(19.359, range=0..100)
first_and_last_index = Panel("""0
-1""")

# ---- group: Divide Curve and create XY Planes
polyline_tolerance = Panel("1")

# comment: Divedes Curve and creates xy planes
curves = Curve([<curve referenced from the Rhino model> x780])

curve_to_polyline = CurveToPolyline(Curve=curves, ToleranceDistance=polyline_tolerance, ToleranceAngle=0)  # -> Polyline, Segments
explode = Explode(Curve=curve_to_polyline.Polyline, Recursive=True)  # -> Segments, Vertices
xy_plane = XYPlane(Origin=explode.Vertices)

# ----
axis_preview_scaling = Slider(18, range=0..100)
preview_plane_axis = PreviewPlaneAxis(plane=flatten(xy_plane), scaling=axis_preview_scaling)

# ---- group: Divide Curve and create XY Planes (continued)
plane = Plane(xy_plane)

# ----
xz_plane = XZPlane(Origin=explode.Vertices)
yz_plane = YZPlane(Origin=explode.Vertices)

plane_2 = Plane(plane)
number = Number(retract_distance)

listpanel = Panel("""0
-1""")
unit_z = UnitZ(Factor=number)
list_item = ListItem(List=plane_2, Index=listpanel, Wrap=True)
vector_display = VectorDisplay(Anchor=list_item, Vector=unit_z)
move = Move(Geometry=list_item, Motion=unit_z)  # -> Geometry, Transform

panel = Panel(list_item)

plane_3 = Plane(move.Geometry)

insert_items = InsertItems(List=plane, Item=plane_3, Indices=first_and_last_index, Wrap=True)
panel_2 = Panel(insert_items)

# ==== cluster PreviewPlaneAxis
plane = ClusterInput()
scaling = ClusterInput()

# ---- group: Preview Plane Axis
plane_2 = Plane(plane)
scaling_2 = Integer(scaling)

deconstruct_plane = DeconstructPlane(Plane=plane_2)  # -> Origin, XAxis, YAxis, ZAxis
pipe_scaling = Panel("16")
cone_length = Panel("4")
cone_radius = Panel("8")
entwine = Entwine(Branch00=deconstruct_plane.XAxis, Branch01=deconstruct_plane.YAxis, Branch02=deconstruct_plane.ZAxis, FlattenInputs=True)
division = Division(A=scaling_2, B=cone_radius)
division_2 = Division(A=scaling_2, B=cone_length)
division_3 = Division(A=scaling_2, B=pipe_scaling)
line_sdl = LineSDL(Start=plane_2, Direction=entwine, Length=scaling_2)
perp_frame = PerpFrame(Curve=reparameterize(line_sdl), Parameter="1")
pipe = Pipe(Curve=line_sdl, Radius=division_3, Caps=0)  # -> simplify(Pipe)
panel = Panel("""X
Y
Z""")
cone = Cone(Base=perp_frame, Radius=division, Length=division_2)  # -> Cone, Tip
trim_tree = TrimTree(Tree=pipe, Depth=1)
text_tag = TextTag(Location=perp_frame, Text=graft(panel), Colour=ColourSwatch(SwatchColor=RGB(255, 255, 255)))
entwine_2 = Entwine(
    Branch00=ColourSwatch(SwatchColor=RGB(255, 0, 0)),
    Branch01=ColourSwatch(SwatchColor=RGB(12, 173, 0)),
    Branch02=ColourSwatch(SwatchColor=RGB(0, 81, 255)),
    FlattenInputs=True)
merge = Merge(Data1=simplify(trim_tree), Data2=simplify(cone.Cone))

custom_preview = CustomPreview(Geometry=merge, Material=entwine_2)
