# Grasshopper definition 1.gh (Grasshopper 1.0.7)
# plug-ins: Robots

pt = Point(<point referenced from the Rhino model>)
series = Series(Start=pt, Step=Slider(3, range=0..100), Count=Slider(6, range=0..100))
xy = XYPlane(Origin=Point(622.4456227, 181.4290015, 0))
crv = Curve(<curve referenced from the Rhino model>)
panel = Panel(series)
rotate = Rotate(Geometry=crv, Angle=degrees(series), Plane=xy)  # -> Geometry, Transform
scale = Scale(Geometry=rotate.Geometry, Center=Point(0, 0, 0), Factor=0.5)  # -> Geometry, Transform
crv_2 = Curve(<curve referenced from the Rhino model>)
arrcurve = CurveArray(Geometry=rotate.Geometry, Curve=crv_2, Count=Slider(11, range=0..100))  # -> Geometry, Transform
divdist = DivideDistance(Distance=Slider(5, range=0..10))  # -> flatten(Points), Tangents, Parameters
panel_2 = Panel(divdist.Points)
xy_2 = XYPlane(Origin=divdist.Points)
pt_2 = Point(<point referenced from the Rhino model>)
list = RobotsLibrary(
    {"AA-KR60", "AA-KR30", "AA-KR60_KR30", "Franka Emika Panda", "Bartlett-IRB120", "Bartlett-IRB1600", "Bartlett-KR6", "Bartlett-KR60-A", "Bartlett-KR60-B", "Bartlett-KR500", "Bartlett-KR60 on track", "Bartlett-UR10", "Bartlett-KR60", "Bartlett-TX200", "Bartlett-TX200L", "Bartlett-RX160", "Bartlett-RX160L", "MIT-ABB-IRB6640_sim", "UR3e", "UR5e", "UR10e", "UR16e", "UR3", "UR5", "UR10"}, selected="UR10e",
    Type=0)
pflip = FlipPlane(Plane=xy_2, ReverseX=False, ReverseY=False, SwapAxes=True)
xy_plane = XYPlane(Origin=pt_2)
flip_plane = FlipPlane(Plane=xy_plane, ReverseX=False, ReverseY=False, SwapAxes=True)
merge = Merge(Data1=flip_plane, Data2=pflip)
list_2 = FlagFields({"Shoulder": 1, "Elbow": 2, "Wrist": 4}, selected=[])
list_3 = ValueList({"Joint", "Linear"}, selected="Joint")
load_robot_system = LoadRobotSystem(Name=list, Base=PlaneXY(0, 0, 0))
pt_3 = Point(<point referenced from the Rhino model>)
tool = CreateTool(Name=pt_3, TCP=PlaneXY(0, 0, 0), Weight="0.1")  # -> Tool, TCP
create_target = CreateTarget(Plane=merge, RobConf=list_2, Motion=list_3, Tool=tool.Tool, Speed=Slider(46, range=0..100), IsCartesian=True)
create_program = CreateProgram(Name="stavmaya6", RobotSystem=load_robot_system, Targets=create_target, StepSize=1)  # -> Program, Code, Duration, Warnings, Errors
path = FilePath("C:\Users\stavs\Desktop\סתיו\שנה ג\סמסטר ב\תייצרו משהו- נוף נתנזון\")
saveprog = SaveProgram(Program=create_program.Program, Folder=path)
program_parameter = ProgramParameter(create_program.Program)
panel_3 = Panel(create_program.Errors)
panel_4 = Panel(create_program.Code)
panel_5 = Panel(create_program.Warnings)
program_simulation = ProgramSimulation(Program=program_parameter, Time=Slider(0, range=0..1), Normalized=True)  # -> SystemMeshes, JointRotations, Plane, Index, Time, Program, Errors
simple_trail = SimpleTrail(Program=program_simulation.Program, Length=500, MechanicalGroup=0)
custom_preview = CustomPreview(
    Geometry=program_simulation.SystemMeshes,
    Material={diffuse=RGB(221, 160, 221), emission=RGB(66, 48, 66), shine=0.5, specular=RGB(255, 255, 255), transparency=0})
