# Grasshopper definition DrawFlatCurves03.gh (Grasshopper 1.0.7)
# plug-ins: Robots, Pufferfish

bounding_rectangle = BoundingRectangle(Geometry=<missing>, Plane=PlaneXY(0, 0, 0), Axis=0, Slide=0, Union=True)  # -> Bounding, DimensionX, DimensionY
retract_distance = Slider(19.359, range=0..100)
first_and_last_index = Panel("""0
-1""")
robots_library = RobotsLibrary(
    {"Bartlett-IRB120", "Bartlett-IRB1600", "Bartlett-KR6", "Bartlett-KR60-A", "Bartlett-KR60-B", "Bartlett-KR500", "Bartlett-KR60 on track", "Bartlett-UR10", "Bartlett-KR60", "Bartlett-TX200", "Bartlett-TX200L", "Bartlett-RX160", "Bartlett-RX160L", "UR3e", "UR5e", "UR10e", "UR16e", "UR3", "UR5", "UR10"}, selected="UR10",
    Type=0)

# ---- group: Start Confirmation Command
panel = Panel("  popup(\"press CONTINUE to start the Program\", title=\"Start Confirmation\", warning=False, error=False, blocking=True)")
custom_command = CustomCommand(Name="Start_Confirmation", Manufacturer="UR", Code=panel)
command_parameter = CommandParameter(custom_command)

# ----
load_robot_system = LoadRobotSystem(Name=robots_library, Base=PlaneXY(0, 0, 0))

# ---- group: Divide Curve and create XY Planes
polyline_tolerance = Panel("1")

# comment: Divedes Curve and creates xy planes
curves = Curve([<curve referenced from the Rhino model> x780])

curve_to_polyline = CurveToPolyline(Curve=curves, ToleranceDistance=polyline_tolerance, ToleranceAngle=0)  # -> Polyline, Segments
explode = Explode(Curve=curve_to_polyline.Polyline, Recursive=True)  # -> Segments, Vertices
xy_plane = XYPlane(Origin=explode.Vertices)

# ----
axis_preview_scaling = Slider(18, range=0..100)
preview_plane_axis = PreviewPlaneAxis(plane=flatten(xy_plane), scaling=axis_preview_scaling)

# ---- group: Divide Curve and create XY Planes (continued)
plane = Plane(xy_plane)

# ----
xz_plane = XZPlane(Origin=explode.Vertices)
yz_plane = YZPlane(Origin=explode.Vertices)

plane_2 = Plane(plane)
number = Number(retract_distance)

listpanel = Panel("""0
-1""")
unit_z = UnitZ(Factor=number)
list_item = ListItem(List=plane_2, Index=listpanel, Wrap=True)
vector_display = VectorDisplay(Anchor=list_item, Vector=unit_z)
move = Move(Geometry=list_item, Motion=unit_z)  # -> Geometry, Transform

panel_2 = Panel(list_item)

plane_3 = Plane(move.Geometry)

insert_items = InsertItems(List=plane, Item=plane_3, Indices=first_and_last_index, Wrap=True)
panel_3 = Panel(insert_items)
plane_4 = Plane(insert_items)

# ---- group: Create Robot Tool
tool_mesh = Mesh(<mesh referenced from the Rhino model>)
point = Point(<point referenced from the Rhino model>)

tool_name = Panel("PenHolder")
mesh_join = MeshJoin(Meshes=tool_mesh)
xy_plane_2 = XYPlane(Origin=point)
tool_weight_in_kg = Panel("0.1")
create_tool = CreateTool(Name=tool_name, TCP=xy_plane_2, Weight=tool_weight_in_kg, Mesh=mesh_join)  # -> Tool, TCP

tool_parameter = ToolParameter(create_tool.Tool)

# ---- group: Create Robot Targets from Planes
blend_radius = Panel("5")
tool_parameter_2 = ToolParameter(tool_parameter)
plane_5 = Plane(plane_4)
zone_parameter = ZoneParameter(blend_radius)

point_list = PointList(Points=plane_5, Size="10")
flag_fields = FlagFields({"Shoulder": 1, "Elbow": 2, "Wrist": 4}, selected="Shoulder")
value_list = ValueList({"Joint", "Linear"}, selected="Linear")
flip_plane = FlipPlane(Plane=plane_5, ReverseX=Toggle(False), ReverseY=Toggle(False), SwapAxes=Toggle(True))
create_target = CreateTarget(
    Plane=flatten(flip_plane),
    RobConf=flag_fields,
    Motion=value_list,
    Tool=tool_parameter_2,
    Zone=zone_parameter,
    IsCartesian=True)

target_parameter = TargetParameter(create_target)

# ---- group: Create Robot Program
robotsystem_parameter = RobotSystemParameter(load_robot_system)
target_parameter_2 = TargetParameter(target_parameter)
command_parameter_2 = CommandParameter(command_parameter)
create_program = CreateProgram(
    Name="DefaultProgram",
    RobotSystem=robotsystem_parameter,
    Targets1=target_parameter_2,
    InitCommands=command_parameter_2,
    StepSize=1)  # -> Program, Code, Duration, Warnings, Errors
program_parameter = ProgramParameter(create_program.Program)

# ----
panel_4 = Panel(create_program.Warnings)

# ---- group: Send to Robot
ip_address = Panel()
program_parameter_2 = ProgramParameter(program_parameter)
boolean = Boolean()
remote_connection = RemoteConnection(Program=program_parameter_2, IP=ip_address, Upload=boolean, Play=False, Pause=False)

# ---- group: Program Simulation
program_parameter_3 = ProgramParameter(program_parameter)

program_simulation = ProgramSimulation(Program=program_parameter_3, Time=0, Normalized=True)  # -> SystemMeshes, JointRotations, Plane, Index, Time, Program, Errors
simple_trail = SimpleTrail(Program=program_simulation.Program, Length=Slider(0, range=0..10000), MechanicalGroup=0)

curve = Curve(simple_trail)

# ==== cluster PreviewPlaneAxis
plane = ClusterInput()
scaling = ClusterInput()

# ---- group: Preview Plane Axis
plane_2 = Plane(plane)
scaling_2 = Integer(scaling)

deconstruct_plane = DeconstructPlane(Plane=plane_2)  # -> Origin, XAxis, YAxis, ZAxis
pipe_scaling = Panel("16")
cone_length = Panel("4")
cone_radius = Panel("8")
entwine = Entwine(Branch00=deconstruct_plane.XAxis, Branch01=deconstruct_plane.YAxis, Branch02=deconstruct_plane.ZAxis, FlattenInputs=True)
division = Division(A=scaling_2, B=cone_radius)
division_2 = Division(A=scaling_2, B=cone_length)
division_3 = Division(A=scaling_2, B=pipe_scaling)
line_sdl = LineSDL(Start=plane_2, Direction=entwine, Length=scaling_2)
perp_frame = PerpFrame(Curve=reparameterize(line_sdl), Parameter="1")
pipe = Pipe(Curve=line_sdl, Radius=division_3, Caps=0)  # -> simplify(Pipe)
panel = Panel("""X
Y
Z""")
cone = Cone(Base=perp_frame, Radius=division, Length=division_2)  # -> Cone, Tip
trim_tree = TrimTree(Tree=pipe, Depth=1)
text_tag = TextTag(Location=perp_frame, Text=graft(panel), Colour=ColourSwatch(SwatchColor=RGB(255, 255, 255)))
entwine_2 = Entwine(
    Branch00=ColourSwatch(SwatchColor=RGB(255, 0, 0)),
    Branch01=ColourSwatch(SwatchColor=RGB(12, 173, 0)),
    Branch02=ColourSwatch(SwatchColor=RGB(0, 81, 255)),
    FlattenInputs=True)
merge = Merge(Data1=simplify(trim_tree), Data2=simplify(cone.Cone))

custom_preview = CustomPreview(Geometry=merge, Material=entwine_2)
