# Grasshopper definition ROBOT DRAWING.gh (Grasshopper 1.0.7)
# plug-ins: Robots

triangular = Triangular(Plane=PlaneXY(0, 0, 0), Size=Slider(10, range=0..10), ExtentX=Slider(53, range=0..100), ExtentY=Slider(30, range=0..100))  # -> Cells, Points
construct_point = ConstructPoint(XCoordinate=Slider(50, range=0..50), YCoordinate=Slider(50, range=0..50), ZCoordinate=0)
construct_point_2 = ConstructPoint(XCoordinate=Slider(200, range=0..200), YCoordinate=Slider(-64, range=-101..200), ZCoordinate=0)
construct_point_3 = ConstructPoint(XCoordinate=Slider(121, range=0..200), YCoordinate=Slider(187, range=0..200), ZCoordinate=0)
merge = Merge(Data1=construct_point, Data2=construct_point_2, Data3=construct_point_3)
point = Point(merge)
tangent_curve = TangentCurve(Vertices=point, Tangents=point, Blend=0.5, Degree=3)  # -> Curve, Length, Domain
point_on_curve = PointOnCurve(tangent_curve.Curve, parameter=0.629)
distance = Distance(PointA=triangular.Points, PointB=point_on_curve)  # -> flatten(Distance)
construct_domain = ConstructDomain(DomainStart=Slider(0, range=0..10), DomainEnd=Slider(5.8, range=0..10))
bounds = Bounds(Numbers=distance)
remap_numbers = RemapNumbers(Value=distance, Source=bounds, Target=construct_domain)  # -> flatten(Mapped), Clipped
circle = Circle(Plane=triangular.Points, Radius=remap_numbers.Mapped)
panel = Panel(remap_numbers.Mapped)

curve = Curve([<curve referenced from the Rhino model> x893])
horizontal_frames = HorizontalFrames(Curve=curve, Count=Slider(1, range=0..10))  # -> flatten(Frames), Parameters
flip_plane = FlipPlane(Plane=horizontal_frames.Frames, ReverseX=False, ReverseY=False, SwapAxes=True)
panel_2 = Panel(horizontal_frames.Frames)

number_slider = Slider(20, range=0..100)
construct_point_4 = ConstructPoint(XCoordinate=Slider(0, range=0..100), YCoordinate=Slider(0, range=0..100), ZCoordinate=number_slider)
cone = Cone(Base=PlaneXY(0, 0, 0), Radius=Slider(10, range=0..10), Length=number_slider)  # -> Cone, Tip
xy_plane = XYPlane(Origin=construct_point_4)
create_tool = CreateTool(Name="TOOL_01", TCP=xy_plane, Weight="0.1", Mesh=cone.Cone)  # -> Tool, TCP

list = RobotsLibrary(
    {"KULeuven-IRB120", "KULeuven-UR5", "KULeuven-UR10", "UR3e", "UR5e", "UR10e", "UR16e", "UR3", "UR5", "UR10"}, selected="UR10e",
    Type=0)
load_robot_system = LoadRobotSystem(Name=list, Base=PlaneXY(0, 0, 0))
list_2 = FlagFields({"Shoulder": 1, "Elbow": 2, "Wrist": 4}, selected="Shoulder")
list_3 = ValueList({"Joint", "Linear"}, selected="Joint")
tool_parameter = ToolParameter(create_tool.Tool)
create_target = CreateTarget(Plane=flip_plane, RobConf=list_2, Motion=list_3, Tool=tool_parameter, IsCartesian=True)
create_program = CreateProgram(Name="C1", RobotSystem=load_robot_system, Targets=create_target, StepSize=1)  # -> Program, Code, Duration, Warnings, Errors
file_path = FilePath("C:\Users\sahar\OneDrive\Desktop\שנה ג\robots\CIRCLES DRAWING.gh")

number_slider_2 = Slider(1, range=0..1)
number_slider_3 = Slider(100, range=0..100)
rectangular = Rectangular(Plane=PlaneXY(0, 0, 0), SizeX=number_slider_2, SizeY=number_slider_2, ExtentX=number_slider_3, ExtentY=number_slider_3)  # -> Cells, Points
point_2 = Point(flatten(rectangular.Points))
deconstruct = Deconstruct(Point=point_2)  # -> XComponent, YComponent, ZComponent
multiplication = Multiplication(A=Slider(3, range=0..10), B=Slider(180, range=0..1000))
multiplication_2 = Multiplication(A=Slider(3, range=0..10), B=Slider(360, range=0..1000))
bounds_2 = Bounds(Numbers=deconstruct.XComponent)
bounds_3 = Bounds(Numbers=deconstruct.YComponent)
construct_domain_2 = ConstructDomain(DomainStart=0, DomainEnd=multiplication_2)
construct_domain_3 = ConstructDomain(DomainStart=0, DomainEnd=multiplication)
remap_numbers_2 = RemapNumbers(Value=deconstruct.XComponent, Source=bounds_2, Target=construct_domain_2)  # -> Mapped, Clipped
remap_numbers_3 = RemapNumbers(Value=deconstruct.YComponent, Source=bounds_3, Target=construct_domain_3)  # -> Mapped, Clipped
radians = Radians(Degrees=remap_numbers_3.Mapped)
radians_2 = Radians(Degrees=remap_numbers_2.Mapped)
number_slider_4 = Slider(3, range=0..10)
sine = Sine(Value=radians)
sine_2 = Sine(Value=radians_2)
multiplication_3 = Multiplication(A=sine, B=number_slider_4)
multiplication_4 = Multiplication(A=sine_2, B=number_slider_4)
multiplication_5 = Multiplication(A=multiplication_4, B=multiplication_3)
unit_z = UnitZ(Factor=multiplication_5)
move = Move(Geometry=point_2, Motion=unit_z)  # -> Geometry, Transform
deconstruct_2 = Deconstruct(Point=move.Geometry)  # -> XComponent, YComponent, ZComponent
button = Button()
construct_point_5 = ConstructPoint(XCoordinate=deconstruct_2.XComponent, YCoordinate=deconstruct_2.YComponent, ZCoordinate=0)
graph_mapper = GraphMapper(
    deconstruct_2.XComponent,
    x0=0,
    x1=1,
    y0=0,
    y1=1,
    amplitude=0.3,
    container_name="Perlin",
    decay=0.3,
    frequency=0.1,
    x_offset=0.5,
    y_offset=0.5)
bounds_4 = Bounds(Numbers=graph_mapper)
remap_numbers_4 = RemapNumbers(Value=graph_mapper, Source=bounds_4, Target=Domain(0, 1))  # -> Mapped, Clipped
addition = Addition(B=remap_numbers_4.Mapped)

panel_3 = Panel(create_program.Code)
program_parameter = ProgramParameter(create_program.Program)
program_simulation = ProgramSimulation(Program=program_parameter, Time=Slider(0, range=0..1), Normalized=True)  # -> SystemMeshes, JointRotations, Plane, Index, Time, Program, Errors
save_program = SaveProgram(Program=create_program.Program)
simple_trail = SimpleTrail(Program=program_simulation.Program, Length=500, MechanicalGroup=0)
panel_5 = Panel("תרגיל 2")
divide_length = DivideLength()  # -> Points, Tangents, Parameters

point_3 = Point(<point referenced from the Rhino model>)
point_4 = Point(<point referenced from the Rhino model>)
point_5 = Point(<point referenced from the Rhino model>)
xy_plane_2 = XYPlane(Origin=point_4)
xy_plane_3 = XYPlane(Origin=point_5)
xy_plane_4 = XYPlane(Origin=point_3)
flip_plane_2 = FlipPlane(Plane=xy_plane_2, ReverseX=False, ReverseY=False, SwapAxes=True)
flip_plane_3 = FlipPlane(Plane=xy_plane_4, ReverseX=False, ReverseY=False, SwapAxes=True)
flip_plane_4 = FlipPlane(Plane=xy_plane_3, ReverseX=False, ReverseY=False, SwapAxes=True)

create_speed = CreateSpeed(
    Translation=100,
    Rotation=3.141592654,
    ExternalTranslation=5000,
    ExternalRotation=18.84955592,
    AccelTranslation=2500,
    AccelAxis=12.56637061)
speed_parameter = SpeedParameter(create_speed)
zone_parameter = ZoneParameter("100")

horizontal_frame = HorizontalFrame(Parameter=divide_length.Parameters)
xy_plane_5 = XYPlane(Origin=divide_length.Points)
flip_plane_5 = FlipPlane(Plane=horizontal_frame, ReverseX=False, ReverseY=False, SwapAxes=True)
plane = Plane(flip_plane_5)
merge_2 = Merge(Data1=flip_plane_2, Data2=flip_plane_3, Data3=flip_plane_4)
