# Grasshopper definition טלי ורז ציור לתרגיל הראשון.gh (Grasshopper 1.0.7)

רדיוס = Slider(39, range=0..100)
אורך = Slider(39, range=0..100)
xy_plane = XYPlane(Origin=Point(0, 0, 0))
cylinder = Cylinder(Base=xy_plane, Radius=רדיוס, Length=אורך)
רדיוס_2 = Slider(39, range=0..100)
circle_cnr = CircleCNR(Center=xy_plane, Normal=Vector(0, 0, 1), Radius=רדיוס)
deconstruct_arc = DeconstructArc(Arc=circle_cnr)  # -> BasePlane, Radius, Angle
unit_z = UnitZ(Factor=אורך)
divide_curve = DivideCurve(Curve=circle_cnr, Count=10, Kinks=Slider(5, range=0..10))  # -> Points, Tangents, Parameters
point = Point(deconstruct_arc.BasePlane)
move = Move(Geometry=point, Motion=unit_z)  # -> Geometry, Transform
cone = Cone(Base=divide_curve.Points, Radius=רדיוס_2, Length=[divide_curve.Parameters, אורך])  # -> Cone, Tip
