# Grasshopper definition תרגיל 01 אור ורון.gh (Grasshopper 1.0.8)

number_slider = Slider(200, range=0..1000)
polygon = Polygon(Plane=PlaneXY(0, 0, 0), Radius=Slider(500, range=0..1000), Segments=Slider(5, range=0..10), FilletRadius=0)  # -> Polygon, Length
series = Series(Start=0, Step=Slider(1, range=0..1), Count=number_slider)
divide_curve = DivideCurve(Curve=polygon.Polygon, Count=number_slider, Kinks=False)  # -> Points, Tangents, Parameters
expression = Expression(x=series, y=Slider(6, range=0..10), Expression="x*y")
list_item = ListItem(List=divide_curve.Points, Index=expression, Wrap=True)
list_item_2 = ListItem(List=divide_curve.Points, Index=series, Wrap=True)
line = Line(StartPoint=list_item_2, EndPoint=list_item)
divide_distance = DivideDistance(Curve=line, Distance=Slider(10, range=0..10))  # -> Points, Tangents, Parameters
construct_plane = ConstructPlane(Origin=divide_distance.Points, XAxis=Vector(1, 0, 0), YAxis=Vector(0, 1, 0))  # -> flatten(Plane)
panel = Panel(construct_plane)
