# Grasshopper definition תרגיל 3 - רון רז טלי ואור.gh (Grasshopper 1.0.7)
# plug-ins: PTComponentLibrary, Robots

construct_point = ConstructPoint(XCoordinate=Slider(150, range=0..300), YCoordinate=0, ZCoordinate=0)
polar_array = PolarArray(Geometry=construct_point, Plane=PlaneXY(0, 0, 0), Count=Slider(8, range=0..10), Angle=6.283185307)  # -> Geometry, Transform
pi = Pi(Factor=Slider(0.5, range=0..1))
line = Line(StartPoint=Point(0, 0, 0), EndPoint=polar_array.Geometry)
plane = Plane(PlaneXY(0, 0, 0))
number_slider = Slider(1, range=0..100)
maelstrom = Maelstrom(Geometry=line, Plane=plane, First=Slider(63.2, range=0..500), Second=Slider(63.2, range=0..500), Angle=pi, Rigid=False)
divide_curve = DivideCurve(Curve=maelstrom, Count=number_slider, Kinks=False)  # -> Points, Tangents, Parameters
# הגדרות בסיסיות
number_slider_2 = Slider(0, range=0..1000)
multiplication = Multiplication(A=divide_curve.Tangents, B=Slider(13, range=0..1000))
shift_list = ShiftList(List=maelstrom, Shift=Slider(1, range=0..1), Wrap=True)
divide_curve_2 = DivideCurve(Curve=shift_list, Count=number_slider, Kinks=False)  # -> Points, Tangents, Parameters
multiplication_2 = Multiplication(A=divide_curve_2.Tangents, B=number_slider_2)
bezier_span = BezierSpan(StartPoint=divide_curve.Points, StartTangent=multiplication, EndPoint=divide_curve_2.Points, EndTangent=multiplication_2)  # -> flatten(Curve), Length, Domain
join_curves = JoinCurves(Curves=shift_list, Preserve=False)  # -> flatten(Curves)
# סידור המישורים
panel = Panel(join_curves)
divide_distance = DivideDistance(Curve=join_curves, Distance=Slider(10, range=0..10), AddEnd=True)
unit_y = UnitY(Factor=Slider(388, range=0..1000))
move = Move(Geometry=shift_list, Motion=unit_y)  # -> Geometry, Transform
unit_z = UnitZ(Factor=Slider(-592, range=-1000..1001))
move_2 = Move(Geometry=move.Geometry, Motion=unit_z)  # -> Geometry, Transform
unit_x = UnitX(Factor=Slider(0, range=0..1000))
move_3 = Move(Geometry=move_2.Geometry, Motion=unit_x)  # -> Geometry, Transform
# הרדיוסים תכלס זהים צריך רק אחד מהם
number_slider_3 = Slider(4.3, range=0..10)
end_points = EndPoints(Curve=move_3.Geometry)  # -> Start, End
dispatch = Dispatch(List=move_3.Geometry, DispatchPattern=[True, False])  # -> ListA, ListB
create_tool = CreateTool(Name="DefaultGHTool", TCP=PlaneXY(0, 0, 0), Weight=number_slider_3)  # -> Tool, TCP
point = Point(end_points.Start)
point_2 = Point(end_points.End)
curve = Curve(dispatch.ListA)
curve_2 = Curve(dispatch.ListB)
list = FlagFields({"Shoulder": 1, "Elbow": 2, "Wrist": 4}, selected="Shoulder")
list_2 = ValueList({"Joint", "Linear"}, selected="Linear")
flip_curve = FlipCurve(Curve=curve)  # -> Curve, Flag
list_3 = RobotsLibrary(
    {"Bartlett-IRB120", "Bartlett-IRB1600", "Bartlett-KR6", "Bartlett-KR60-A", "Bartlett-KR60-B", "Bartlett-KR500", "Bartlett-KR60 on track", "Bartlett-UR10", "Bartlett-KR60", "Bartlett-TX200", "Bartlett-TX200L", "Bartlett-RX160", "Bartlett-RX160L", "UR3e", "UR5e", "UR10e", "UR16e", "UR3", "UR5", "UR10"}, selected="UR10e",
    Type=0)
weave = Weave(Pattern=[0, 1], Stream0=flip_curve.Curve, Stream1=curve_2, NullGaps=False)
end_points_2 = EndPoints(Curve=curve_2)  # -> Start, End
end_points_3 = EndPoints(Curve=flip_curve.Curve)  # -> Start, End
number_slider_4 = Slider(10, range=0..10)
point_3 = Point(end_points_2.End)
number_slider_5 = Slider(30, range=0..100)
load_robot_system = LoadRobotSystem(Name=list_3, Base=PlaneXY(0, 0, 0))
point_4 = Point(end_points_3.Start)
unit_z_2 = UnitZ(Factor=Slider(10, range=0..1000))
curve_3 = Curve(flatten(<curve referenced from the Rhino model>))
panel_2 = Panel(curve_3)
file_path = FilePath("C:\Users\ronal\OneDrive\שולחן העבודה\שנה ג\סימסטר ב\עשה זאת בעצמך\")
linear_array = LinearArray(Geometry=curve_3, Direction=unit_z_2, Count=Slider(30, range=0..100))  # -> reverse(flatten(Geometry)), Transform
divide_distance_2 = DivideDistance(Curve=flatten(linear_array.Geometry), Distance=Slider(10, range=0..10))  # -> Points, Tangents, Parameters
point_list = PointList(Points=divide_distance_2.Points)
panel_3 = Panel(divide_distance_2.Points)
flip_plane = FlipPlane(Plane=divide_distance_2.Points, ReverseX=False, ReverseY=False, SwapAxes=True)  # -> flatten(Plane)
plane_2 = Plane(flatten(flip_plane))
create_target = CreateTarget(
    Plane=reverse(plane_2),
    RobConf=list,
    Motion=list_2,
    Tool=create_tool.Tool,
    Speed=Slider(50, range=0..100),
    Zone=Slider(10, range=0..10),
    IsCartesian=True)
create_program = CreateProgram(Name="ronronronron7777", RobotSystem=load_robot_system, Targets=create_target, StepSize=1)  # -> Program, Code, Duration, Warnings, Errors
panel_4 = Panel(create_program.Warnings)
program_simulation = ProgramSimulation(Program=create_program.Program, Time=0, Normalized=True)  # -> SystemMeshes, JointRotations, Plane, Index, Time, Program, Errors
simple_trail = SimpleTrail(Program=program_simulation.Program, Length=Slider(2000, range=0..10000), MechanicalGroup=0)
save_program = SaveProgram(Program=create_program.Program, Folder=file_path)
point_list_2 = PointList(Points=flip_plane)
panel_5 = Panel(linear_array.Geometry)
