# Grasshopper definition TOOL.gh (Grasshopper 1.0.7)
# plug-ins: Robots

robots_library = RobotsLibrary(
    {"Franka Emika Panda", "Bartlett-IRB120", "Bartlett-IRB1600", "Bartlett-KR6", "Bartlett-KR60-A", "Bartlett-KR60-B", "Bartlett-KR500", "Bartlett-KR60 on track", "Bartlett-UR10", "Bartlett-KR60", "Bartlett-TX200", "Bartlett-TX200L", "Bartlett-RX160", "Bartlett-RX160L"}, selected="Bartlett-UR10",
    Type=0)
rectangular = Rectangular(
    Plane=Plane(origin=(787.5114867, -9.800676827, 0), x=(0, 1, 0), y=(1, 0, 0)),
    SizeX=Slider(30, range=0..100),
    SizeY=Slider(50, range=0..100),
    ExtentX=Slider(10, range=0..10),
    ExtentY=Slider(10, range=0..10))  # -> Cells, flatten(Points)
construct_point = ConstructPoint(XCoordinate=0, YCoordinate=0, ZCoordinate=Slider(200, range=0..200))
construct_point_2 = ConstructPoint(XCoordinate=0, YCoordinate=0, ZCoordinate=0)
panel = Panel(rectangular.Points)
construct_plane = ConstructPlane(Origin=construct_point, XAxis=Vector(1, 0, 0), YAxis=Vector(0, 1, 0))
panel_2 = Panel(rectangular.Cells)
create_tool = CreateTool(Name="tool", TCP=construct_plane, Weight="0.1", Mesh=<geometry referenced from the Rhino model>)  # -> Tool, TCP
list = FlagFields({"Shoulder": 1, "Elbow": 2, "Wrist": 4}, selected="Shoulder")
point_list = PointList(Points=rectangular.Points, Size=Slider(10, range=0..10))
list_2 = ValueList({"Joint", "Linear"}, selected="Joint")
load_robot_system = LoadRobotSystem(Name=robots_library, Base=PlaneXY(0, 0, 0))
list_item = ListItem(List=rectangular.Points, Index="24", Wrap=True)
list_item_2 = ListItem(List=rectangular.Points, Index="96", Wrap=True)
line = Line(StartPoint=list_item, EndPoint=list_item_2)
panel_3 = Panel(rectangular.Points)
curve_closest_point = CurveClosestPoint(Point=flatten(panel_3), Curve=flatten(line))  # -> Point, Parameter, flatten(Distance)
random_reduce = RandomReduce(List=curve_closest_point.Point, Reduction=Slider(100, range=0..1000), Seed=Slider(10, range=0..10))
partition_list = PartitionList(List=random_reduce, Size=Slider(7, range=0..10))
random = Random(Range=Slider(10, range=0..10), Number=Slider(3, range=0..10), Seed=2)
list_item_3 = ListItem(List=partition_list, Index=Slider(1, range=0..1), Wrap=True)
circle_cnr = CircleCNR(Center=list_item_3, Normal=Vector(0, 0, 1), Radius=random)
curve = Curve(circle_cnr)
curve_2 = Curve([line, rectangular.Cells])
horizontal_frames = HorizontalFrames(Curve=[curve_2, curve], Count=Slider(1, range=0..10))  # -> flatten(Frames), Parameters
flip_plane = FlipPlane(Plane=horizontal_frames.Frames, ReverseX=False, ReverseY=False, SwapAxes=True)
plane = Plane(flip_plane)
create_target = CreateTarget(Plane=plane, RobConf=list, Motion=list_2, Tool=create_tool.Tool, IsCartesian=True)
create_program = CreateProgram(Name="DefaultProgram", RobotSystem=load_robot_system, Targets=create_target, StepSize=1)  # -> Program, Code, Duration, Warnings, Errors
panel_4 = Panel(create_program.Warnings)
panel_5 = Panel(create_program.Errors)
program_parameter = ProgramParameter(create_program.Program)
program_simulation = ProgramSimulation(Program=program_parameter, Time=Slider(0, range=0..1), Normalized=True)  # -> SystemMeshes, JointRotations, Plane, Index, Time, Program, Errors
simple_trail = SimpleTrail(Program=program_simulation.Program, Length=Slider(2000, range=0..2000), MechanicalGroup=0)
custom_preview = CustomPreview(
    Geometry=program_simulation.SystemMeshes,
    Material={diffuse=RGB(221, 160, 221), emission=RGB(66, 48, 66), shine=0.5, specular=RGB(255, 255, 255), transparency=0})

point = Point(Point(873.4016442, 500, 500))
point_2 = Point(Point(1076.82343, 103.7538663, 511.808762))
point_3 = Point(Point(500, 500, 500))

xy_plane = XYPlane(Origin=point_3)
xy_plane_2 = XYPlane(Origin=point)
xy_plane_3 = XYPlane(Origin=point_2)
flip_plane_2 = FlipPlane(Plane=xy_plane_2, ReverseX=False, ReverseY=False, SwapAxes=True)
flip_plane_3 = FlipPlane(Plane=xy_plane_3, ReverseX=False, ReverseY=False, SwapAxes=True)
flip_plane_4 = FlipPlane(Plane=xy_plane, ReverseX=False, ReverseY=False, SwapAxes=True)

point_4 = Point(point_2)

merge = Merge(Data1=flip_plane_4, Data2=flip_plane_2, Data3=flip_plane_3)

line_2 = Line(StartPoint=point_4, EndPoint=point_3)
panel_6 = Panel(line_2)
